% Simulink data dictionary BMS_Software_DD_NXP.sldd
% references Shared_DD.sldd
% references DD_CAN_TX_RX.sldd

BMS_Sw_CodeGenConfig_NXP = Simulink.ConfigSet(StartTime="0", StopTime="10", Solver="FixedStepDiscrete", ProdHWDeviceType="ARM Compatible->ARM Cortex", SystemTargetFile="mbd_s32k.tlc", TargetLang="C")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
LockOCVTable = Simulink.Signal(DataType="uint8", InitialValue="0")
PreviousSOC = Simulink.Signal(DataType="uint8")
MaxCellVoltage = Simulink.Signal(DataType="single")
MinCellVoltage = Simulink.Signal(DataType="single")
MaxCellTemp = Simulink.Signal(DataType="single")
MinCellTemp = Simulink.Signal(DataType="single")
MaxTempNumber = Simulink.Signal(DataType="uint8")
MinTempNumber = Simulink.Signal(DataType="uint8")
BMS_Cell_Voltages_Event = Simulink.Signal(DataType="boolean")
BMS_ID_Event = Simulink.Signal(DataType="boolean")
BMS_Threshold_Event = Simulink.Signal(DataType="boolean")
Real_Time_Packets_Event = Simulink.Signal(DataType="boolean")
OvervoltageErrorThreshold = 84
OvervoltageWarningThreshold = 83
UnderVoltageErrorThreshold = 60
UnderVoltageWarningThreshold = 66
CellOvervoltageErrorThreshold = 4.2
CellOvervoltageWarningThreshold = 4.15
CellUndervoltageErrorThreshold = 3
CellUndervoltageWarningThreshold = 3.3
DischargeOvertempErrorThreshold = 50
DischargeOvertempWarningThreshold = 45
DischargeLowtempErrorThreshold = 5
DischargeLowtempWarningThreshold = 10
ChargingOvertempErrorThreshold = 50
ChargingOvertempWarningThreshold = 45
ChargingLowtempErrorThreshold = 5
ChargingLowtempWarningThreshold = 10
BMS_Packet5_Event = Simulink.Signal(DataType="boolean")
DischargeOvercurrentErrorThreshold = 100
DischargeOvercurrentWarningThreshold = 80
ChargingOvercurrentErrorThreshold = 56
ChargingOvercurrentWarningThreshold = 40