% Simulink data dictionary Battery_16Packs_1RC.sldd

CellType = 1
NumModules = 1

BMS_Input = Simulink.Bus()
  Cell_Voltages: single[20]
  Pack_Voltage: single
  Pack_Current: single
  Vout_Chgr: single
  Vout_Invtr: single
  Cell_Temperatures: single[14]

Ns_Module = 20

BMS_Output = Simulink.Bus()
  DischargeCurrentLimit: single
  ChargeCurrentLimit: single
  ChargeCurrentReq: single
  PosContactorChgrCmd: boolean
  PreChargeRelayChgrCmd: boolean
  NegContactorChgrCmd: boolean
  PosContactorInvtrCmd: boolean
  PreChargeRelayInvtrCmd: boolean
  NegContactorInvtrCmd: boolean
  BalCmd: boolean[20]
  Relay: boolean

Battery = struct(
  SOC_LUT=[0; 0.1; 0.2; 0.3; 0.4; 0.5; 0.6; 0.7; 0.8; 0.9; 1],
  Temperature_LUT=[278.15 293.15 323.15],
  Capacity_LUT=[4 4 4],
  Em_LUT=[3.426 3.426 3.426
   3.456 3.456 3.456
   3.486440381 3.486440381 3.486440381
   3.579349965 3.579349965 3.579349965
   3.613053138 3.613053138 3.613053138
   3.644300879 3.644300879 3.644300879
   3.699462471 3.699462471 3.699462471
   3.801437003 3.801437003 3.801437003
   3.899725482 3.899725482 3.899725482
   4.011111136 4.011111136 4.011111136
   4.14684743 4.14684743 4.14684743],
  R0_LUT=[0.01 0.01 0.01
   0.01 0.01 0.01
   0.028843336 0.028843336 0.028843336
   0.025475912 0.025475912 0.025475912
   0.023020362 0.023020362 0.023020362
   0.022984728 0.022984728 0.022984728
   0.024459867 0.024459867 0.024459867
   0.028445093 0.028445093 0.028445093
   0.026146617 0.026146617 0.026146617
   0.022707249 0.022707249 0.022707249
   0.020454193 0.020454193 0.020454193],
  R1_LUT=[0.005 0.005 0.005
   0.004997667 0.004997667 0.004997667
   0.008978556 0.008978556 0.008978556
   0.023243272 0.023243272 0.023243272
   0.021728323 0.021728323 0.021728323
   0.013758993 0.013758993 0.013758993
   0.009918627 0.009918627 0.009918627
   0.018300098 0.018300098 0.018300098
   0.012496212 0.012496212 0.012496212
   0.010147167 0.010147167 0.010147167
   0.007934104 0.007934104 0.007934104],
  C1_LUT=[10000 10000 10000
   9994.884 9994.884 9994.884
   12627.53 12627.53 12627.53
   8286.918 8286.918 8286.918
   5009.287 5009.287 5009.287
   6121.276 6121.276 6121.276
   11581.12 11581.12 11581.12
   17747.17 17747.17 17747.17
   9926.52 9926.52 9926.52
   4124.057 4124.057 4124.057
   3718.353 3718.353 3718.353],
  cell_mass=0.84,
  cell_rho_Cp=2040000,
  cell_Cp_heat=964.92,
  T_init=298.15,
  Qe_init=7.75,
  R_bleed=20,
  h_conv=5,
  cell_area=0.1019,
  TempInit=298.15,
  Em_LUT1D=[3.426; 3.456; 3.486440381; 3.579349965; 3.613053138; 3.644300879; 3.699462471; 3.801437003; 3.899725482; 4.011111136; 4.14684743],
  SOCLUT_DS=[0; 0.05; 0.1; 0.15; 0.2; 0.25; 0.3; 0.35; 0.4; 0.45; 0.5; 0.55; 0.6; 0.65; 0.7; 0.75; 0.8; 0.85; 0.9; 0.95; 1],
  OCVLUT_DS=[3.42; 3.455; 3.5; 3.55; 3.58; 3.596; 3.61; 3.623; 3.637; 3.654; 3.683; 3.728; 3.765; 3.804; 3.848; 3.897; 3.948; 4.001; 4.059; 4.12; 4.19])