% Simulink data dictionary Shared_DD.sldd
% references Battery_16Packs_1RC.sldd

BMS_Info = Simulink.Bus()
  Faults: Bus: Faults
  BMS_State: Enum: BMS_State_Enum
  SOC: single[3 1]

SRE = enum(DefaultValue="Balancing", StorageType="int8")
  Balancing = 0
  Charging = 1
  Driving = 2

ts = 0.05
OverCellVoltageLimit = single(4.2)
BMS_Sw_CodeGenConfig = Simulink.ConfigSet(StartTime="0", StopTime="20000", Solver="FixedStepDiscrete", ProdHWDeviceType="Texas Instruments->TMS570 Cortex-R4", SystemTargetFile="ert.tlc", TargetLang="C")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
TestCase = 1
UnderCellVoltageLimit = single(3)

Faults = Simulink.Bus()
  OverCurrentDischarging: boolean
  HighTempDischarging: boolean
  LowTempDischarging: boolean
  VoltSensor: boolean
  OverCurrentCharging: boolean
  HighTempCharging: boolean
  LowTempCharging: boolean
  OverVolt: boolean
  UnderVolt: boolean
  Charger: boolean
  Inverter: boolean